# Grasshopper definition point.gh (Grasshopper 1.0.8)
# plug-ins: Pufferfish, Human

# ----
# デバッグ
pcloud = PointCloud(<point cloud referenced from the Rhino model>)
point_cloud = PointCloudAttributes(Cloud=pcloud)  # -> Cloud, Locations, Normals, flatten(Colours), Extra, Hidden
vec = Vector(point_cloud.Normals)
panel = Panel(point_cloud.Cloud)
pt = Point(point_cloud.Locations)
vdis = VectorDisplay(Anchor=pt, Vector=vec)

point_cloud_guid = Guid()
point_cloud_2 = PointCloudAttributes(Cloud=point_cloud_guid)  # -> Cloud, Locations, Normals, flatten(Colours), Extra, Hidden

# ----
# 法線方向の推定
avr = Average(Input=point_cloud_2.Normals)
unit = UnitVector(Vector=avr)
devec = DeconstructVector(Vector=unit)  # -> XComponent, YComponent, ZComponent
estimate_plane_normal = CSharpScript(
    nx=devec.XComponent,
    ny=devec.YComponent,
    nz=devec.ZComponent,
    parallel_threshold=Slider(0.95, range=0..1),
    perpendicular_threshold=Slider(0.05, range=0..0.1))  # -> out, plane, plane_type, unit_normal; inputs nx: Double, ny: Double, nz: Double, parallel_threshold: Double, perpendicular_threshold: Double
# ---------- estimate_plane_normal: C# ----------
// Grasshopper Script Instance
#region Usings
using System;
using System.Linq;
using System.Collections;
using System.Collections.Generic;
using System.Drawing;

using Rhino;
using Rhino.Geometry;

using Grasshopper;
using Grasshopper.Kernel;
using Grasshopper.Kernel.Data;
using Grasshopper.Kernel.Types;
#endregion

public class Script_Instance : GH_ScriptInstance
{
    private void RunScript(
		double nx,
		double ny,
		double nz,
		double parallel_threshold,
		double perpendicular_threshold,
		ref object plane,
		ref object plane_type,
		ref object unit_normal)
    {
        string type = "";
        Vector3d normal;

        if (Math.Abs(nx) > parallel_threshold)
        {
            // X軸に平行な法線 -> YZ平面
            normal = new Vector3d(Math.Sign(nx), 0, 0);
            type = "YZ平面";
        }
        else if (Math.Abs(ny) > parallel_threshold)
        {
            // Y軸に平行な法線 -> XZ平面
            normal = new Vector3d(0, Math.Sign(ny), 0);
            type = "XZ平面";
        }
        else if (Math.Abs(nz) > parallel_threshold)
        {
            // Z軸に平行な法線 -> XY平面
            normal = new Vector3d(0, 0, Math.Sign(nz));
            type = "XY平面";
        }
        else if (Math.Abs(nx) < perpendicular_threshold)
        {
            // X軸に垂直 -> YZ面内の向き
            normal = new Vector3d(0, ny, nz);
            type = "X軸に垂直な面";
        }
        else if (Math.Abs(ny) < perpendicular_threshold)
        {
            // Y軸に垂直 -> XZ面内の向き
            normal = new Vector3d(nx, 0, nz);
            type = "Y軸に垂直な面";
        }
        else if (Math.Abs(nz) < perpendicular_threshold)
        {
            // Z軸に垂直 -> XY面内の向き
            normal = new Vector3d(nx, ny, 0);
            type = "Z軸に垂直な面";
        }
        // STEP 3: 一般的な傾斜面
        else
        {
            normal = new Vector3d(nx, ny, nz);
            type = "傾斜面";
        }
        Plane estimate_plane = new Plane(Point3d.Origin, normal);        
        // 結果を出力
        plane = estimate_plane;
        plane_type = type;
        unit_normal = normal;
    }
}
# ---------- end estimate_plane_normal ----------
pln = Plane(estimate_plane_normal.plane)
panel_2 = Panel(estimate_plane_normal.plane_type)

brec = BoundingRectangle(Geometry=point_cloud_2.Locations, Plane=pln, Axis=0, Slide=0, Union=True)  # -> Bounding, DimensionX, DimensionY
area = Area(Geometry=brec.Bounding)  # -> Area, Centroid

# ----
# 点群の中央値へ法線方向に移動するベクトル
avr_2 = Average(Input=point_cloud_2.Locations)
pt_2 = Point(avr_2)
subtraction = Subtraction(A=pt_2, B=area.Centroid)
vec_2 = Vector(estimate_plane_normal.unit_normal)
dprod = DotProduct(VectorA=subtraction, VectorB=vec_2, Unitize=False)
multiplication = Multiplication(A=vec_2, B=dprod)

srf = Surface(brec.Bounding)

# ----
# サーフェイスを格納するLayer
panel_3 = Panel("surfaces")
layers = CreateModifyLayers(LayerName=panel_3, DeleteLayer=False, enableFullPath=False)  # -> LayerNames, LayerFullPath
createatts = CreateAttributes(LayerName=layers.LayerNames, enableFullPath=False)

move = Move(Geometry=srf, Motion=multiplication)  # -> Geometry, Transform
execute = Boolean(False)
bake = BakeGeometry(Bake=execute, Geometry=move.Geometry, Attributes=createatts, DeleteOldBakes=False, PreserveTrees=False)
